# Grasshopper definition RunIT.gh (Grasshopper 1.0.7)
# plug-ins: MLGlattice

number_slider = Slider(10, range=0..10)
nickname = Genlattice(Choice=Slider(1, range=0..1), M_STradi=Slider(0.015, range=0..0.1))
