# Grasshopper definition RunITINCLINDED.gh (Grasshopper 1.0.7)
# plug-ins: MLGlattice

pt = Point(Point(1, 1, 1))
unit = UnitVector(Vector=pt)
division = Division(A=unit, B=-10000)
nickname = MlGLatInclinedLoad(
    GLatticeDir="D://LatticeStructure//",
    DisVec=division,
    StartIND=Slider(10001, range=0..100000),
    EndIND=Slider(12500, range=0..100000))  # disabled
